# Grasshopper definition Logger_test.gh (Grasshopper 0.9.76)
# plug-ins: treesloth01, DesignLogger, Sift

number_slider = Slider(16.17, range=0..20)
number_slider_2 = Slider(13.97, range=0..20)
number_slider_3 = Slider(17.51, range=0..20)
panel = Panel([number_slider, number_slider_3, number_slider_2])
run_session = BooleanToggle(False)
favorite = Button()
mm = MassMultiplication(Input=[number_slider, number_slider_3, number_slider_2])  # -> Result, PartialResults
ma = MassAddition(Input=[number_slider, number_slider_3, number_slider_2])  # -> Result, PartialResults
toggle = BooleanToggle(False)
end_session = Button()
panel_2 = Panel(ma.Result)
dlog = DesignLogger(
    Start=run_session,
    ParticipantNumber="1234",
    SessionLength=Slider(30, range=0..100),
    LogPath="C:\Temp\Results.csv",
    Month=Slider(1, range=0..1),
    Day=Slider(1, range=0..1),
    Hour=Slider(11, range=0..12),
    DesignVector=[number_slider, number_slider_3, number_slider_2],
    ObjectiveVector=[ma.Result, mm.Result],
    Favorite=favorite,
    End=end_session)
data = Data(dlog)
clean = CleanTree(RemoveNulls=True, RemoveInvalid=True, RemoveEmpty=Toggle(True), Tree=data)
renumber = RenumberPaths(Data=clean)
sift = Sift(Variables=[number_slider, number_slider_3, number_slider_2], DesignMap=renumber, Index=Slider(3, range=0..4))  # disabled
panel_4 = Panel(renumber)
